# Dynamo graph script.dyn (Dynamo 2.6.2.15705)
# packages: Data-Shapes 2022.2.103, Structural Design 2021.1.22, Orchid 206.3.0.8161, Clockwork for Dynamo 2.x 2.4.0, Genius Loci 2021.11.10, spring nodes 210.1.1

o_document_activeview = Orchid.RevitProject.Common.Document.ActiveView()
firstItem = List.FirstItem()  # unwired: list
byBestFitThroughPoints = Line.ByBestFitThroughPoints()  # unwired: bestFitPoints
byUnion = Solid.ByUnion()  # unwired: solids
code_block = CodeBlock { "Armadura Cabezal"; }
file_path = Filename("..\..\..\..\..\..\..\..\..\..\Arainco\Arainco.png")
code_block_2 = CodeBlock { "INICIAR"; "CANCELAR"; true; 430; 170; 650; }
categories_ᶜᵒⁿᵛᵉʳᵗᵉᵈ_ᵈʳᵒᵖᵈᵒʷⁿ = CodeBlock { "Seleccionar Muros a Armar"; "SELECCIONAR"; Revit.Category.ByName(["Walls","Structural Foundations"]); }
selectmodelelements_data = Custom[SelectModelElements Data](InputName=categories_ᶜᵒⁿᵛᵉʳᵗᵉᵈ_ᵈʳᵒᵖᵈᵒʷⁿ.out0, ButtonText=categories_ᶜᵒⁿᵛᵉʳᵗᵉᵈ_ᵈʳᵒᵖᵈᵒʷⁿ.out1, CategoryFilter=categories_ᶜᵒⁿᵛᵉʳᵗᵉᵈ_ᵈʳᵒᵖᵈᵒʷⁿ.out2)  # package Data-Shapes; Creates a Revit element selection input for UI.MultipleInputForm++ . Check out www.data-shapes.net for more infos!
code_block_3 = CodeBlock { "Seleccionar Cara de\nDistribucion"; "SELECCIONAR"; }
selectfaces_data = Custom[SelectFaces Data](InputName=code_block_3.out0, ButtonText=code_block_3.out1)  # package Data-Shapes; Creates a Revit face selection input for UI.MultipleInputForm++. Check out www.data-shapes.net for more infos!
code_block_4 = CodeBlock { "Puntos de Empalme"; "SELECCIONAR"; }
selectfaces_data_2 = Custom[SelectFaces Data](InputName=code_block_4.out0, ButtonText=code_block_4.out1)
code_block_5 = CodeBlock { "Datos de Armadura"; }
code_block_6 = CodeBlock { "Diametro"; }
element_types_ᶜᵒⁿᵛᵉʳᵗᵉᵈ_ᵈʳᵒᵖᵈᵒʷⁿ = CodeBlock { DSCore.Types.FindTypeByNameInAssembly("RebarBarType", "RevitAPI"); }
all_elements_of_type = ElementsOfType(element_type=element_types_ᶜᵒⁿᵛᵉʳᵗᵉᵈ_ᵈʳᵒᵖᵈᵒʷⁿ)
code_block_7 = CodeBlock(t5=all_elements_of_type)
# ---------- code_block_7.designscript (8 lines) ----------
t4 = t5;
t1 = t4;
num1 = Properties.RebarDiameter(t1);
t2 = DSCore.List.SortByKey(t1, num1);
t3 = Dictionary.ValueAtKey(t2, "sorted list");
str1 = Revit.Elements.Element.Name(t3);
0;
false;
# ----------------------------------------
dropdown_data = Custom[DropDown Data](InputName=code_block_6, Keys=code_block_7.str1, Values=code_block_7.t3, DefaultValueIndex=code_block_7.out6, Sorted_optional=code_block_7.out7)  # package Data-Shapes; Create data for DropDown input in UI.MultiInputForm ++ . Check out www.data-shapes.net for more infos.
code_block_8 = CodeBlock { "Cantidad de Barras"; "2"; true; }
textbox_data = Custom[TextBox Data](InputName=code_block_8.out0, DefaultText=code_block_8.out1, IsNumberEntry=code_block_8.out2)  # package Data-Shapes; Create Data for TextBox input in UI.MultipleInputForm ++ . Check out www.data-shapes.net for more informations
code_block_9 = CodeBlock { "Capa"; ["1ª Capa", "2ª Capa", "3ª Capa", "4ª Capa", "5ª Capa"]; [40, 90, 140, 190, 240]; 0; }
dropdown_data_2 = Custom[DropDown Data](InputName=code_block_9.out0, Keys=code_block_9.out1, Values=code_block_9.out2, DefaultValueIndex=code_block_9.out3)
list_create = List.Create(item0=dropdown_data, item1=textbox_data, item2=dropdown_data_2)
inputgroup_data = Custom[InputGroup Data](GroupTitle=code_block_5, Inputs=list_create)  # package Data-Shapes; Creates a group of inputs for UI.MultipleInputForm ++ . Check out www.data-shapes.net for more infos !
list_create_2 = List.Create(item0=selectmodelelements_data, item1=selectfaces_data, item2=selectfaces_data_2, item3=inputgroup_data)
multipleinputform = Custom[MultipleInputForm ++](Description_optional=code_block, Logo_optional=file_path, ButtonText_optional=code_block_2.out0, Inputs=list_create_2, Toggle=code_block_2.out2, CancelButtonText_optional=code_block_2.out1, MaxHeight_optional=code_block_2.out5, Width_optional=code_block_2.out3, LabelWidth_optional=code_block_2.out4)  # package Data-Shapes; Create a form with multiple inputs. see www.data-shapes.net for tutorials and infos!
code_block_10 = CodeBlock(l=multipleinputform.User_Inputs)
# ---------- code_block_10.designscript (12 lines) ----------
l;
[Imperative]
{
	if (l == null)
	{
		return = [[],[],[],[],[],[]];
	}
	else
	{
		return = l;
	}
};
# ----------------------------------------
code_block_11 = CodeBlock(x=code_block_10.out1) { x; }
code_block_12 = CodeBlock(x=code_block_11) { x[0]; }
geometry = Element.Geometry(element=code_block_12)
flatten = List.Flatten(list=geometry)
function_apply = ApplyFunction(func=byUnion, arg1=flatten)
code_block_13 = CodeBlock(l=function_apply)
# ---------- code_block_13.designscript (12 lines) ----------
l;
[Imperative]
{
	if (l == null)
	{
		return = [];
	}
	else
	{
		return = l;
	}
};
# ----------------------------------------
byLoft = Surface.ByLoft()  # unwired: crossSections
code_block_14 = CodeBlock(x=code_block_11) { x[1]; }
flipNormalDirection = Surface.FlipNormalDirection(surface=code_block_14)
code_block_15 = CodeBlock { 0.5; }
normalAtParameter = Surface.NormalAtParameter(surface=flipNormalDirection, u=code_block_15, v=code_block_15)
code_block_16 = CodeBlock(x=code_block_11) { x[5]; }
translate = Geometry.Translate(geometry=flipNormalDirection, direction=normalAtParameter, distance=code_block_16)
perimeterCurves = Surface.PerimeterCurves(surface=translate)
flatten_2 = List.Flatten(list=perimeterCurves)
code_block_17 = CodeBlock { null; }
replaceEmptyLists = Custom[List.ReplaceEmptyLists](seq=flatten_2, Replacement=code_block_17)  # package Clockwork for Dynamo 2.x; Replaces all empty lists within a given list with a substitute
code_block_18 = CodeBlock(x=replaceEmptyLists)
# ---------- code_block_18.designscript (13 lines) ----------
x;

[Imperative]
{
	if (x == null)
	{
		return = [null,null,null];
	}
	else
	{
		return = x;
	}
};
# ----------------------------------------
code_block_19 = CodeBlock { [0,2]; }
getItemAtIndex = List.GetItemAtIndex(list=code_block_18.out1, index=code_block_19)
list_clean = Custom[List Clean](list=getItemAtIndex)  # package Genius Loci; Removes all Null, Empty and Blank from a list or nested list of lists.
code_block_20 = CodeBlock { 100000; }
extendEnd = Curve.ExtendEnd(curve=list_clean, distance=code_block_20)
code_block_21 = CodeBlock { 100000; }
extendStart = Curve.ExtendStart(curve=extendEnd, distance=code_block_21)
function_apply_2 = ApplyFunction(func=byLoft, arg1=extendStart)
intersect = Geometry.Intersect(geometry=code_block_13.out1, other=function_apply_2)
code_block_22 = CodeBlock { 0.5; }
pointAtParameter = Surface.PointAtParameter(surface=intersect, v=code_block_22)
code_block_23 = CodeBlock { 1; 0.5; }
pointAtParameter_2 = Surface.PointAtParameter(surface=intersect, u=code_block_23.out0, v=code_block_23.out1)
list_create_3 = List.Create(item0=pointAtParameter, item1=pointAtParameter_2)
flatten_3 = List.Flatten(list=list_create_3)
function_apply_3 = ApplyFunction(func=byBestFitThroughPoints, arg1=flatten_3)
code_block_24 = CodeBlock(l=function_apply_3)  # same code as code_block_13
direction = Line.Direction(line=code_block_24.out1)
Z = Vector.Z(vector=direction)
code_block_25 = CodeBlock { 0; }
lt = Z < code_block_25
reverse = Curve.Reverse(curve=code_block_24.out1)
if_ = If(test=lt, true=reverse, false=code_block_24.out1)
code_block_26 = CodeBlock(line1=if_) { curve1 = Autodesk.Curve.ExtendStart(line1, -50); curve2 = Autodesk.Curve.ExtendEnd(curve1, -20); }
code_block_27 = CodeBlock(x=code_block_11) { x[2]; }
code_block_28 = CodeBlock { 0.5; }
pointAtParameter_3 = Surface.PointAtParameter(surface=code_block_27, u=code_block_28, v=code_block_28)
byOriginNormal = Plane.ByOriginNormal(origin=pointAtParameter_3)
intersect_2 = Geometry.Intersect(geometry=code_block_26.curve2, other=byOriginNormal)
flatten_4 = List.Flatten(list=intersect_2)
splitByPoints = Curve.SplitByPoints(curve=code_block_26.curve2, points=flatten_4)
code_block_29 = CodeBlock(x=code_block_11) { x[1]; }
flipNormalDirection_2 = Surface.FlipNormalDirection(surface=code_block_29)
byBestFitThroughPoints_2 = Line.ByBestFitThroughPoints()  # unwired: bestFitPoints
code_block_30 = CodeBlock { 0.5; }
pointAtParameter_4 = Surface.PointAtParameter(surface=code_block_29, v=code_block_30)
code_block_31 = CodeBlock { 1; 0.5; }
pointAtParameter_5 = Surface.PointAtParameter(surface=code_block_29, u=code_block_31.out0, v=code_block_31.out1)
list_create_4 = List.Create(item0=pointAtParameter_4, item1=pointAtParameter_5)
flatten_5 = List.Flatten(list=list_create_4)
function_apply_4 = ApplyFunction(func=byBestFitThroughPoints_2, arg1=flatten_5)
code_block_32 = CodeBlock(l=function_apply_4)  # same code as code_block_13
code_block_33 = CodeBlock { 90; 0.5; }
planeAtParameter = Curve.PlaneAtParameter(curve=code_block_32.out1, param=code_block_33.out1)
rotate = Geometry.Rotate(geometry=flipNormalDirection_2, basePlane=planeAtParameter, degrees=code_block_33.out0)
code_block_34 = CodeBlock { 0.5; }
normalAtParameter_2 = Surface.NormalAtParameter(surface=rotate, u=code_block_34, v=code_block_34)
code_block_35 = CodeBlock(x=code_block_12) { x; }
getCategory = Element.GetCategory()  # unwired: element
function_apply_5 = ApplyFunction(func=getCategory, arg1=code_block_35)
string_from_object = FromObject(obj=function_apply_5)
code_block_36 = CodeBlock { "Walls"; }
eq = string_from_object == code_block_36
code_block_37 = CodeBlock(l=eq)
# ---------- code_block_37.designscript (12 lines) ----------
l;
[Imperative]
{
	if (l == false)
	{
		return = [];
	}
	else
	{
		return = l;
	}
};
# ----------------------------------------
filterByBoolMask = List.FilterByBoolMask(list=code_block_35, mask=code_block_37.out1)
geometry_2 = Element.Geometry(element=filterByBoolMask.in)
flatten_6 = List.Flatten(list=geometry_2)
code_block_38 = CodeBlock { 0.2; }
pointAtParameter_6 = Curve.PointAtParameter(curve=splitByPoints, param=code_block_38)
doesIntersect = Geometry.DoesIntersect(geometry=flatten_6@L1, other=pointAtParameter_6@L2, lacing=Longest)
o_list_anytrue = Orchid.Common.List.AnyTrue(list=doesIntersect)
filterByBoolMask_2 = List.FilterByBoolMask(list=filterByBoolMask.in, mask=o_list_anytrue)
code_block_39 = CodeBlock(t6=filterByBoolMask_2.in)
# ---------- code_block_39.designscript (6 lines) ----------
t4 = t6;
t2 = t4;
t1 = Revit.Elements.Element.GetParameterValueByName(t2, "Type");
t3 = Revit.Elements.Element.GetParameterValueByName(t1, "Width");
t5 = t3 / 2;
t7 = t5 - 40;
# ----------------------------------------
translate_2 = Geometry.Translate(geometry=splitByPoints, direction=normalAtParameter_2, distance=code_block_39.t7, lacing=Longest)
code_block_40 = CodeBlock(x=code_block_11) { x[3]; }
traslapo_armadura = CodeBlock(rebar=code_block_40)
# ---------- traslapo_armadura.designscript (5 lines) ----------
diametro_barra = Strings.ToString(Properties.RebarDiameter(rebar),"");
key = ["8","10","12","16","18","22","25","28","32","36"];
val = [570, 710, 860, 1140, 1290, 1960, 2230, 2500, 2850, 3210];
dict_traslapo = Dictionary.ByKeysValues(key, val);
t3 = Dictionary.ValueAtKey(dict_traslapo, diametro_barra);
# ----------------------------------------
extendEnd_2 = Curve.ExtendEnd(curve=translate_2, distance=traslapo_armadura.t3)
function_apply_6 = ApplyFunction(func=firstItem, arg1=extendEnd_2)
element_types_ᶜᵒⁿᵛᵉʳᵗᵉᵈ_ᵈʳᵒᵖᵈᵒʷⁿ_2 = CodeBlock { DSCore.Types.FindTypeByNameInAssembly("RebarHookType", "RevitAPI"); }
all_elements_of_type_2 = ElementsOfType(element_type=element_types_ᶜᵒⁿᵛᵉʳᵗᵉᵈ_ᵈʳᵒᵖᵈᵒʷⁿ_2)
rebar_hook_type_at_start = CodeBlock(t3=all_elements_of_type_2)
# ---------- rebar_hook_type_at_start.designscript (5 lines) ----------
t1 = t3;
str2 = Revit.Elements.Element.Name(t1);
t2 = str2 == "Standard - 90 deg.";
t4 = DSCore.List.FilterByBoolMask(t3, t2);
t5 = Dictionary.ValueAtKey(t4, "in");
# ----------------------------------------
direction_2 = Line.Direction(line=code_block_32.out1)
Z_2 = Vector.Z(vector=direction_2)
code_block_41 = CodeBlock { 0; }
lt_2 = Z_2 < code_block_41
code_block_42 = CodeBlock { "Left"; "Right"; }
if_2 = If(test=lt_2, true=code_block_42.out0, false=code_block_42.out1)
firstItem_2 = List.FirstItem()  # unwired: list
function_apply_7 = ApplyFunction(func=firstItem_2, arg1=filterByBoolMask_2.in)
reverse_2 = Vector.Reverse(vector=normalAtParameter_2)
code_block_43 = CodeBlock(curves=function_apply_6, rebarBarType=code_block_40, startHookType=rebar_hook_type_at_start.t5, startHookOrientation=if_2, endtHookOrientation=if_2, hostElement=function_apply_7, vector=reverse_2)
# ---------- code_block_43.designscript (18 lines) ----------
//curves
curves;
//rebarStyle
"Standard";
//rebarBarType
rebarBarType;
//startHookType
startHookType;
//endHookType
null;
//startHookOrientation
startHookOrientation;
//endtHookOrientation
endtHookOrientation;
//hostElement
hostElement;
//vector
vector;
# ----------------------------------------
fromCurves = StructuralDesign.Rebar.Create.FromCurves(curves=code_block_43.curves@L1, rebarStyle=code_block_43.out1@L1, rebarBarType=code_block_43.rebarBarType@L1, startHookType=code_block_43.startHookType@L1, endHookType=code_block_43.out4@L1, startHookOrientation=code_block_43.startHookOrientation@L1, endHookOrientation=code_block_43.endtHookOrientation@L1, hostElement=code_block_43.hostElement@L1, vector=code_block_43.vector@L1, lacing=Longest)
code_block_44 = CodeBlock(t2=filterByBoolMask_2.in)
# ---------- code_block_44.designscript (3 lines) ----------
t1 = Revit.Elements.Element.GetParameterValueByName(t2, "Type");
t3 = Revit.Elements.Element.GetParameterValueByName(t1, "Width");
t4 = t3 - 80;
# ----------------------------------------
code_block_45 = CodeBlock(x=code_block_11) { x[4]; }
setLayoutAsFixedNumber = StructuralDesign.Rebar.Layout.SetLayoutAsFixedNumber(rebar=fromCurves, arrayLength=code_block_44.t4, numberOfBarPositions=code_block_45)
element_types_ᶜᵒⁿᵛᵉʳᵗᵉᵈ_ᵈʳᵒᵖᵈᵒʷⁿ_3 = CodeBlock { DSCore.Types.FindTypeByNameInAssembly("RebarShape", "RevitAPI"); }
all_elements_of_type_3 = ElementsOfType(element_type=element_types_ᶜᵒⁿᵛᵉʳᵗᵉᵈ_ᵈʳᵒᵖᵈᵒʷⁿ_3)
code_block_46 = CodeBlock(t1=all_elements_of_type_3)
# ---------- code_block_46.designscript (5 lines) ----------
"Shape";
str2 = Revit.Elements.Element.Name(t1);
t2 = str2 == "R_S_01";
t3 = DSCore.List.FilterByBoolMask(t1, t2);
t4 = Dictionary.ValueAtKey(t3, "in");
# ----------------------------------------
setParameterByName = Element.SetParameterByName(element=setLayoutAsFixedNumber, parameterName=code_block_46.out0, value=code_block_46.t4, lacing=Longest)
rebarCenterlineCurves = StructuralDesign.Rebar.Properties.RebarCenterlineCurves(rebar=setParameterByName)
flatten_7 = List.Flatten(list=rebarCenterlineCurves)
code_block_47 = CodeBlock { 0.5; }
pointAtParameter_7 = Curve.PointAtParameter(curve=flatten_7, param=code_block_47)
code_block_48 = CodeBlock()
# ---------- code_block_48.designscript (4 lines) ----------
family1 = Revit.Family.ByName("EST_A_STRUCTURAL REBAR TAG_STANDAR");
familytype1 = Revit.Elements.FamilyType.ByFamilyAndName(family1, "R_S_01");
true;
true;
# ----------------------------------------
create_tag = Custom[Create Tag](view=o_document_activeview@L1, element=setParameterByName@L1, TagLocation=pointAtParameter_7@L1, TagType=code_block_48.familytype1@L1, addLeader=code_block_48.out2@L1, RunIt=code_block_48.out3@L1, lacing=Longest)  # package Genius Loci; Works only in Revit 2018 and later. Creates a tag at a given location, of given type and in a supplied view. The node also works with Linked Elements (except space and area), Multi Category tag and Material Tag. Based on an archilab node
flatten_8 = List.Flatten(list=create_tag)
code_block_49 = CodeBlock { "Walls"; }
byName = Category.ByName(name=code_block_49)
o_document_activeview_2 = Orchid.RevitProject.Common.Document.ActiveView()
all_elements_of_category_in_view = ElementsOfCategoryInView(Category=byName, View=o_document_activeview_2)
geometry_3 = Element.Geometry(element=all_elements_of_category_in_view)
flatten_9 = List.Flatten(list=geometry_3)
byUnion_2 = Solid.ByUnion(solids=flatten_9)
annotation_boundingbox = Custom[Annotation BoundingBox](element=flatten_8)  # package Genius Loci; Get the BoundingBox of the view specific element. (Text, tag, etc)
code_block_50 = CodeBlock { null; }
replaceEmptyLists_2 = Custom[List.ReplaceEmptyLists](seq=annotation_boundingbox.Centroid, Replacement=code_block_50)
code_block_51 = CodeBlock(x=replaceEmptyLists_2)
# ---------- code_block_51.designscript (13 lines) ----------
x;

[Imperative]
{
	if (x == null)
	{
		return = Autodesk.Point.Origin();
	}
	else
	{
		return = x;
	}
};
# ----------------------------------------
code_block_52 = CodeBlock { 100; 2000; 100; }
byLengths = Cuboid.ByLengths(origin=code_block_51.out1, width=code_block_52.out0, length=code_block_52.out1, height=code_block_52.out2)
doesIntersect_2 = Geometry.DoesIntersect(geometry=byUnion_2, other=byLengths, lacing=Longest)
filterByBoolMask_3 = List.FilterByBoolMask(list=flatten_8@L2, mask=doesIntersect_2@L2)
flatten_10 = List.Flatten(list=filterByBoolMask_3.in)
mirror = Geometry.Mirror()  # unwired: geometry, mirrorPlane
annotation_boundingbox_2 = Custom[Annotation BoundingBox](element=flatten_10@L2)
taggedElement = Tag.TaggedElement()  # unwired: tag
function_apply_8 = ApplyFunction(func=taggedElement, arg1=flatten_10)
code_block_53 = CodeBlock { null; }
replaceEmptyLists_3 = Custom[List.ReplaceEmptyLists](seq=function_apply_8, Replacement=code_block_53)
code_block_54 = CodeBlock(l=replaceEmptyLists_3)
# ---------- code_block_54.designscript (12 lines) ----------
l;
[Imperative]
{
	if (l == null)
	{
		return = [];
	}
	else
	{
		return = l[0];
	}
};
# ----------------------------------------
rebarCenterlineCurves_2 = StructuralDesign.Rebar.Properties.RebarCenterlineCurves(rebar=code_block_54.out1)
length = Curve.Length(curve=rebarCenterlineCurves_2)
maximumItem = List.MaximumItem(list=length)
eq_2 = length == maximumItem
filterByBoolMask_4 = List.FilterByBoolMask(list=rebarCenterlineCurves_2, mask=eq_2)
flatten_11 = List.Flatten(list=filterByBoolMask_4.in)
code_block_55 = CodeBlock { 0.5; }
pointAtParameter_8 = Curve.PointAtParameter(curve=flatten_11, param=code_block_55)
o_document_activeview_3 = Orchid.RevitProject.Common.Document.ActiveView()
plane = Custom[View.Plane](view=o_document_activeview_3)  # package Clockwork for Dynamo 2.x; Retrieves the plane of a given view
normal = Plane.Normal(plane=plane)
byOriginNormal_2 = Plane.ByOriginNormal(origin=pointAtParameter_8, normal=normal)
byLine = StructuralDesign.Model.Geom.Vector.ByLine(line=flatten_11)
code_block_56 = CodeBlock { 90; }
rotate_2 = Geometry.Rotate(geometry=byOriginNormal_2, origin=pointAtParameter_8, axis=byLine, degrees=code_block_56)
function_apply_9 = ApplyFunction(func=mirror, arg1=annotation_boundingbox_2.Centroid, arg2=rotate_2)
tag_setlocation = Custom[Tag SetLocation](tag=flatten_10@L2, location=function_apply_9@L2)  # package Genius Loci; Moves the head of the tag to the given location point.
o_document_activeview_4 = Orchid.RevitProject.Common.Document.ActiveView()
byBestFitThroughPoints_3 = Line.ByBestFitThroughPoints()  # unwired: bestFitPoints
byUnion_3 = Solid.ByUnion()  # unwired: solids
code_block_57 = CodeBlock(x=code_block_10.out1) { x; }
code_block_58 = CodeBlock(x=code_block_57) { x[0]; }
geometry_4 = Element.Geometry(element=code_block_58)
flatten_12 = List.Flatten(list=geometry_4)
function_apply_10 = ApplyFunction(func=byUnion_3, arg1=flatten_12)
code_block_59 = CodeBlock(l=function_apply_10)  # same code as code_block_13
byLoft_2 = Surface.ByLoft()  # unwired: crossSections
code_block_60 = CodeBlock(x=code_block_57) { x[1]; }
flipNormalDirection_3 = Surface.FlipNormalDirection(surface=code_block_60)
code_block_61 = CodeBlock { 0.5; }
normalAtParameter_3 = Surface.NormalAtParameter(surface=flipNormalDirection_3, u=code_block_61, v=code_block_61)
code_block_62 = CodeBlock(x=code_block_57) { x[5]; }
translate_3 = Geometry.Translate(geometry=flipNormalDirection_3, direction=normalAtParameter_3, distance=code_block_62)
perimeterCurves_2 = Surface.PerimeterCurves(surface=translate_3)
flatten_13 = List.Flatten(list=perimeterCurves_2)
code_block_63 = CodeBlock { null; }
replaceEmptyLists_4 = Custom[List.ReplaceEmptyLists](seq=flatten_13, Replacement=code_block_63)
code_block_64 = CodeBlock(x=replaceEmptyLists_4)  # same code as code_block_18
code_block_65 = CodeBlock { [0,2]; }
getItemAtIndex_2 = List.GetItemAtIndex(list=code_block_64.out1, index=code_block_65)
list_clean_2 = Custom[List Clean](list=getItemAtIndex_2)
code_block_66 = CodeBlock { 100000; }
extendEnd_3 = Curve.ExtendEnd(curve=list_clean_2, distance=code_block_66)
code_block_67 = CodeBlock { 100000; }
extendStart_2 = Curve.ExtendStart(curve=extendEnd_3, distance=code_block_67)
function_apply_11 = ApplyFunction(func=byLoft_2, arg1=extendStart_2)
intersect_3 = Geometry.Intersect(geometry=code_block_59.out1, other=function_apply_11)
code_block_68 = CodeBlock { 0.5; }
pointAtParameter_9 = Surface.PointAtParameter(surface=intersect_3, v=code_block_68)
code_block_69 = CodeBlock { 1; 0.5; }
pointAtParameter_10 = Surface.PointAtParameter(surface=intersect_3, u=code_block_69.out0, v=code_block_69.out1)
list_create_5 = List.Create(item0=pointAtParameter_9, item1=pointAtParameter_10)
flatten_14 = List.Flatten(list=list_create_5)
function_apply_12 = ApplyFunction(func=byBestFitThroughPoints_3, arg1=flatten_14)
code_block_70 = CodeBlock(l=function_apply_12)  # same code as code_block_13
direction_3 = Line.Direction(line=code_block_70.out1)
Z_3 = Vector.Z(vector=direction_3)
code_block_71 = CodeBlock { 0; }
lt_3 = Z_3 < code_block_71
reverse_3 = Curve.Reverse(curve=code_block_70.out1)
if_3 = If(test=lt_3, true=reverse_3, false=code_block_70.out1)
code_block_72 = CodeBlock(line1=if_3) { curve1 = Autodesk.Curve.ExtendStart(line1, -50); curve2 = Autodesk.Curve.ExtendEnd(curve1, -20); }
code_block_73 = CodeBlock(x=code_block_57) { x[2]; }
code_block_74 = CodeBlock { 0.5; }
pointAtParameter_11 = Surface.PointAtParameter(surface=code_block_73, u=code_block_74, v=code_block_74)
byOriginNormal_3 = Plane.ByOriginNormal(origin=pointAtParameter_11)
intersect_4 = Geometry.Intersect(geometry=code_block_72.curve2, other=byOriginNormal_3)
flatten_15 = List.Flatten(list=intersect_4)
splitByPoints_2 = Curve.SplitByPoints(curve=code_block_72.curve2, points=flatten_15)
code_block_75 = CodeBlock(x=code_block_57) { x[1]; }
flipNormalDirection_4 = Surface.FlipNormalDirection(surface=code_block_75)
byBestFitThroughPoints_4 = Line.ByBestFitThroughPoints()  # unwired: bestFitPoints
code_block_76 = CodeBlock { 0.5; }
pointAtParameter_12 = Surface.PointAtParameter(surface=code_block_75, v=code_block_76)
code_block_77 = CodeBlock { 1; 0.5; }
pointAtParameter_13 = Surface.PointAtParameter(surface=code_block_75, u=code_block_77.out0, v=code_block_77.out1)
list_create_6 = List.Create(item0=pointAtParameter_12, item1=pointAtParameter_13)
flatten_16 = List.Flatten(list=list_create_6)
function_apply_13 = ApplyFunction(func=byBestFitThroughPoints_4, arg1=flatten_16)
code_block_78 = CodeBlock(l=function_apply_13)  # same code as code_block_13
code_block_79 = CodeBlock { 90; 0.5; }
planeAtParameter_2 = Curve.PlaneAtParameter(curve=code_block_78.out1, param=code_block_79.out1)
rotate_3 = Geometry.Rotate(geometry=flipNormalDirection_4, basePlane=planeAtParameter_2, degrees=code_block_79.out0)
code_block_80 = CodeBlock { 0.5; }
normalAtParameter_4 = Surface.NormalAtParameter(surface=rotate_3, u=code_block_80, v=code_block_80)
code_block_81 = CodeBlock(x=code_block_58) { x; }
getCategory_2 = Element.GetCategory()  # unwired: element
function_apply_14 = ApplyFunction(func=getCategory_2, arg1=code_block_81)
string_from_object_2 = FromObject(obj=function_apply_14)
code_block_82 = CodeBlock { "Walls"; }
eq_3 = string_from_object_2 == code_block_82
code_block_83 = CodeBlock(l=eq_3)  # same code as code_block_37
filterByBoolMask_5 = List.FilterByBoolMask(list=code_block_81, mask=code_block_83.out1)
geometry_5 = Element.Geometry(element=filterByBoolMask_5.in)
flatten_17 = List.Flatten(list=geometry_5)
code_block_84 = CodeBlock { 0.2; }
pointAtParameter_14 = Curve.PointAtParameter(curve=splitByPoints_2, param=code_block_84)
doesIntersect_3 = Geometry.DoesIntersect(geometry=flatten_17@L1, other=pointAtParameter_14@L2, lacing=Longest)
o_list_anytrue_2 = Orchid.Common.List.AnyTrue(list=doesIntersect_3)
filterByBoolMask_6 = List.FilterByBoolMask(list=filterByBoolMask_5.in, mask=o_list_anytrue_2)
code_block_85 = CodeBlock(t6=filterByBoolMask_6.in)  # same code as code_block_39
translate_4 = Geometry.Translate(geometry=splitByPoints_2, direction=normalAtParameter_4, distance=code_block_85.t7, lacing=Longest)
code_block_86 = CodeBlock(x=code_block_57) { x[3]; }
traslapo_armadura_2 = CodeBlock(rebar=code_block_86)  # same code as traslapo_armadura
extendEnd_4 = Curve.ExtendEnd(curve=translate_4, distance=traslapo_armadura_2.t3)
ꟿ_list_dropfirstlast = Custom[ꟿ List.DropFirstLast](list=extendEnd_4)  # package spring nodes; Removes the first and last items from the list
direction_4 = Line.Direction(line=code_block_78.out1)
Z_4 = Vector.Z(vector=direction_4)
code_block_87 = CodeBlock { 0; }
lt_4 = Z_4 < code_block_87
code_block_88 = CodeBlock { "Left"; "Right"; }
if_4 = If(test=lt_4, true=code_block_88.out0, false=code_block_88.out1)
ꟿ_list_dropfirstlast_2 = Custom[ꟿ List.DropFirstLast](list=filterByBoolMask_6.in)
reverse_4 = Vector.Reverse(vector=normalAtParameter_4)
code_block_89 = CodeBlock(curves=ꟿ_list_dropfirstlast.rest, rebarBarType=code_block_86, startHookOrientation=if_4, endtHookOrientation=if_4, hostElement=ꟿ_list_dropfirstlast_2.rest, vector=reverse_4)
# ---------- code_block_89.designscript (18 lines) ----------
//curves
curves;
//rebarStyle
"Standard";
//rebarBarType
rebarBarType;
//startHookType
null;
//endHookType
null;
//startHookOrientation
startHookOrientation;
//endtHookOrientation
endtHookOrientation;
//hostElement
hostElement;
//vector
vector;
# ----------------------------------------
fromCurves_2 = StructuralDesign.Rebar.Create.FromCurves(curves=code_block_89.curves@L1, rebarStyle=code_block_89.out1@L1, rebarBarType=code_block_89.rebarBarType@L1, startHookType=code_block_89.out3@L1, endHookType=code_block_89.out4@L1, startHookOrientation=code_block_89.startHookOrientation@L1, endHookOrientation=code_block_89.endtHookOrientation@L1, hostElement=code_block_89.hostElement@L1, vector=code_block_89.vector@L1, lacing=Longest)
code_block_90 = CodeBlock(t2=filterByBoolMask_6.in)  # same code as code_block_44
code_block_91 = CodeBlock(x=code_block_57) { x[4]; }
setLayoutAsFixedNumber_2 = StructuralDesign.Rebar.Layout.SetLayoutAsFixedNumber(rebar=fromCurves_2, arrayLength=code_block_90.t4, numberOfBarPositions=code_block_91)
element_types_ᶜᵒⁿᵛᵉʳᵗᵉᵈ_ᵈʳᵒᵖᵈᵒʷⁿ_4 = CodeBlock { DSCore.Types.FindTypeByNameInAssembly("RebarShape", "RevitAPI"); }
all_elements_of_type_4 = ElementsOfType(element_type=element_types_ᶜᵒⁿᵛᵉʳᵗᵉᵈ_ᵈʳᵒᵖᵈᵒʷⁿ_4)
code_block_92 = CodeBlock(t1=all_elements_of_type_4)
# ---------- code_block_92.designscript (5 lines) ----------
"Shape";
str2 = Revit.Elements.Element.Name(t1);
t2 = str2 == "R_S_00";
t3 = DSCore.List.FilterByBoolMask(t1, t2);
t4 = Dictionary.ValueAtKey(t3, "in");
# ----------------------------------------
setParameterByName_2 = Element.SetParameterByName(element=setLayoutAsFixedNumber_2, parameterName=code_block_92.out0, value=code_block_92.t4, lacing=Longest)
rebarCenterlineCurves_3 = StructuralDesign.Rebar.Properties.RebarCenterlineCurves(rebar=setParameterByName_2)
code_block_93 = CodeBlock { 0.5; }
pointAtParameter_15 = Curve.PointAtParameter(curve=rebarCenterlineCurves_3, param=code_block_93)
code_block_94 = CodeBlock()
# ---------- code_block_94.designscript (4 lines) ----------
family1 = Revit.Family.ByName("EST_A_STRUCTURAL REBAR TAG_STANDAR");
familytype1 = Revit.Elements.FamilyType.ByFamilyAndName(family1, "R_S_00");
true;
true;
# ----------------------------------------
create_tag_2 = Custom[Create Tag](view=o_document_activeview_4@L1, element=setParameterByName_2@L1, TagLocation=pointAtParameter_15@L1, TagType=code_block_94.familytype1@L1, addLeader=code_block_94.out2@L1, RunIt=code_block_94.out3@L1, lacing=Longest)
flatten_18 = List.Flatten(list=create_tag_2)
code_block_95 = CodeBlock { "Walls"; }
byName_2 = Category.ByName(name=code_block_95)
o_document_activeview_5 = Orchid.RevitProject.Common.Document.ActiveView()
all_elements_of_category_in_view_2 = ElementsOfCategoryInView(Category=byName_2, View=o_document_activeview_5)
geometry_6 = Element.Geometry(element=all_elements_of_category_in_view_2)
flatten_19 = List.Flatten(list=geometry_6)
byUnion_4 = Solid.ByUnion(solids=flatten_19)
annotation_boundingbox_3 = Custom[Annotation BoundingBox](element=flatten_18)
code_block_96 = CodeBlock { null; }
replaceEmptyLists_5 = Custom[List.ReplaceEmptyLists](seq=annotation_boundingbox_3.Centroid, Replacement=code_block_96)
code_block_97 = CodeBlock(x=replaceEmptyLists_5)  # same code as code_block_51
code_block_98 = CodeBlock { 100; 2000; 100; }
byLengths_2 = Cuboid.ByLengths(origin=code_block_97.out1, width=code_block_98.out0, length=code_block_98.out1, height=code_block_98.out2)
doesIntersect_4 = Geometry.DoesIntersect(geometry=byUnion_4, other=byLengths_2, lacing=Longest)
filterByBoolMask_7 = List.FilterByBoolMask(list=flatten_18@L2, mask=doesIntersect_4@L2)
flatten_20 = List.Flatten(list=filterByBoolMask_7.in)
mirror_2 = Geometry.Mirror()  # unwired: geometry, mirrorPlane
annotation_boundingbox_4 = Custom[Annotation BoundingBox](element=flatten_20@L2)
taggedElement_2 = Tag.TaggedElement()  # unwired: tag
function_apply_15 = ApplyFunction(func=taggedElement_2, arg1=flatten_20)
code_block_99 = CodeBlock { null; }
replaceEmptyLists_6 = Custom[List.ReplaceEmptyLists](seq=function_apply_15, Replacement=code_block_99)
code_block_100 = CodeBlock(l=replaceEmptyLists_6)  # same code as code_block_54
rebarCenterlineCurves_4 = StructuralDesign.Rebar.Properties.RebarCenterlineCurves(rebar=code_block_100.out1)
length_2 = Curve.Length(curve=rebarCenterlineCurves_4)
maximumItem_2 = List.MaximumItem(list=length_2)
eq_4 = length_2 == maximumItem_2
filterByBoolMask_8 = List.FilterByBoolMask(list=rebarCenterlineCurves_4, mask=eq_4)
flatten_21 = List.Flatten(list=filterByBoolMask_8.in)
code_block_101 = CodeBlock { 0.5; }
pointAtParameter_16 = Curve.PointAtParameter(curve=flatten_21, param=code_block_101)
o_document_activeview_6 = Orchid.RevitProject.Common.Document.ActiveView()
plane_2 = Custom[View.Plane](view=o_document_activeview_6)
normal_2 = Plane.Normal(plane=plane_2)
byOriginNormal_4 = Plane.ByOriginNormal(origin=pointAtParameter_16, normal=normal_2)
byLine_2 = StructuralDesign.Model.Geom.Vector.ByLine(line=flatten_21)
code_block_102 = CodeBlock { 90; }
rotate_4 = Geometry.Rotate(geometry=byOriginNormal_4, origin=pointAtParameter_16, axis=byLine_2, degrees=code_block_102)
function_apply_16 = ApplyFunction(func=mirror_2, arg1=annotation_boundingbox_4.Centroid, arg2=rotate_4)
tag_setlocation_2 = Custom[Tag SetLocation](tag=flatten_20@L2, location=function_apply_16@L2)
o_document_activeview_7 = Orchid.RevitProject.Common.Document.ActiveView()
lastItem = List.LastItem()  # unwired: list
byBestFitThroughPoints_5 = Line.ByBestFitThroughPoints()  # unwired: bestFitPoints
byUnion_5 = Solid.ByUnion()  # unwired: solids
code_block_103 = CodeBlock(x=code_block_10.out1) { x; }
code_block_104 = CodeBlock(x=code_block_103) { x[0]; }
geometry_7 = Element.Geometry(element=code_block_104)
flatten_22 = List.Flatten(list=geometry_7)
function_apply_17 = ApplyFunction(func=byUnion_5, arg1=flatten_22)
code_block_105 = CodeBlock(l=function_apply_17)  # same code as code_block_13
byLoft_3 = Surface.ByLoft()  # unwired: crossSections
code_block_106 = CodeBlock(x=code_block_103) { x[1]; }
flipNormalDirection_5 = Surface.FlipNormalDirection(surface=code_block_106)
code_block_107 = CodeBlock { 0.5; }
normalAtParameter_5 = Surface.NormalAtParameter(surface=flipNormalDirection_5, u=code_block_107, v=code_block_107)
code_block_108 = CodeBlock(x=code_block_103) { x[5]; }
translate_5 = Geometry.Translate(geometry=flipNormalDirection_5, direction=normalAtParameter_5, distance=code_block_108)
perimeterCurves_3 = Surface.PerimeterCurves(surface=translate_5)
flatten_23 = List.Flatten(list=perimeterCurves_3)
code_block_109 = CodeBlock { null; }
replaceEmptyLists_7 = Custom[List.ReplaceEmptyLists](seq=flatten_23, Replacement=code_block_109)
code_block_110 = CodeBlock(x=replaceEmptyLists_7)  # same code as code_block_18
code_block_111 = CodeBlock { [0,2]; }
getItemAtIndex_3 = List.GetItemAtIndex(list=code_block_110.out1, index=code_block_111)
list_clean_3 = Custom[List Clean](list=getItemAtIndex_3)
code_block_112 = CodeBlock { 100000; }
extendEnd_5 = Curve.ExtendEnd(curve=list_clean_3, distance=code_block_112)
code_block_113 = CodeBlock { 100000; }
extendStart_3 = Curve.ExtendStart(curve=extendEnd_5, distance=code_block_113)
function_apply_18 = ApplyFunction(func=byLoft_3, arg1=extendStart_3)
intersect_5 = Geometry.Intersect(geometry=code_block_105.out1, other=function_apply_18)
code_block_114 = CodeBlock { 0.5; }
pointAtParameter_17 = Surface.PointAtParameter(surface=intersect_5, v=code_block_114)
code_block_115 = CodeBlock { 1; 0.5; }
pointAtParameter_18 = Surface.PointAtParameter(surface=intersect_5, u=code_block_115.out0, v=code_block_115.out1)
list_create_7 = List.Create(item0=pointAtParameter_17, item1=pointAtParameter_18)
flatten_24 = List.Flatten(list=list_create_7)
function_apply_19 = ApplyFunction(func=byBestFitThroughPoints_5, arg1=flatten_24)
code_block_116 = CodeBlock(l=function_apply_19)  # same code as code_block_13
direction_5 = Line.Direction(line=code_block_116.out1)
Z_5 = Vector.Z(vector=direction_5)
code_block_117 = CodeBlock { 0; }
lt_5 = Z_5 < code_block_117
reverse_5 = Curve.Reverse(curve=code_block_116.out1)
if_5 = If(test=lt_5, true=reverse_5, false=code_block_116.out1)
code_block_118 = CodeBlock(line1=if_5) { curve1 = Autodesk.Curve.ExtendStart(line1, -50); curve2 = Autodesk.Curve.ExtendEnd(curve1, -20); }
code_block_119 = CodeBlock(x=code_block_103) { x[2]; }
code_block_120 = CodeBlock { 0.5; }
pointAtParameter_19 = Surface.PointAtParameter(surface=code_block_119, u=code_block_120, v=code_block_120)
byOriginNormal_5 = Plane.ByOriginNormal(origin=pointAtParameter_19)
intersect_6 = Geometry.Intersect(geometry=code_block_118.curve2, other=byOriginNormal_5)
flatten_25 = List.Flatten(list=intersect_6)
splitByPoints_3 = Curve.SplitByPoints(curve=code_block_118.curve2, points=flatten_25)
code_block_121 = CodeBlock(x=code_block_103) { x[1]; }
flipNormalDirection_6 = Surface.FlipNormalDirection(surface=code_block_121)
byBestFitThroughPoints_6 = Line.ByBestFitThroughPoints()  # unwired: bestFitPoints
code_block_122 = CodeBlock { 0.5; }
pointAtParameter_20 = Surface.PointAtParameter(surface=code_block_121, v=code_block_122)
code_block_123 = CodeBlock { 1; 0.5; }
pointAtParameter_21 = Surface.PointAtParameter(surface=code_block_121, u=code_block_123.out0, v=code_block_123.out1)
list_create_8 = List.Create(item0=pointAtParameter_20, item1=pointAtParameter_21)
flatten_26 = List.Flatten(list=list_create_8)
function_apply_20 = ApplyFunction(func=byBestFitThroughPoints_6, arg1=flatten_26)
code_block_124 = CodeBlock(l=function_apply_20)  # same code as code_block_13
code_block_125 = CodeBlock { 90; 0.5; }
planeAtParameter_3 = Curve.PlaneAtParameter(curve=code_block_124.out1, param=code_block_125.out1)
rotate_5 = Geometry.Rotate(geometry=flipNormalDirection_6, basePlane=planeAtParameter_3, degrees=code_block_125.out0)
code_block_126 = CodeBlock { 0.5; }
normalAtParameter_6 = Surface.NormalAtParameter(surface=rotate_5, u=code_block_126, v=code_block_126)
code_block_127 = CodeBlock(x=code_block_104) { x; }
getCategory_3 = Element.GetCategory()  # unwired: element
function_apply_21 = ApplyFunction(func=getCategory_3, arg1=code_block_127)
string_from_object_3 = FromObject(obj=function_apply_21)
code_block_128 = CodeBlock { "Walls"; }
eq_5 = string_from_object_3 == code_block_128
code_block_129 = CodeBlock(l=eq_5)  # same code as code_block_37
filterByBoolMask_9 = List.FilterByBoolMask(list=code_block_127, mask=code_block_129.out1)
geometry_8 = Element.Geometry(element=filterByBoolMask_9.in)
flatten_27 = List.Flatten(list=geometry_8)
code_block_130 = CodeBlock { 0.2; }
pointAtParameter_22 = Curve.PointAtParameter(curve=splitByPoints_3, param=code_block_130)
doesIntersect_5 = Geometry.DoesIntersect(geometry=flatten_27@L1, other=pointAtParameter_22@L2, lacing=Longest)
o_list_anytrue_3 = Orchid.Common.List.AnyTrue(list=doesIntersect_5)
filterByBoolMask_10 = List.FilterByBoolMask(list=filterByBoolMask_9.in, mask=o_list_anytrue_3)
code_block_131 = CodeBlock(t6=filterByBoolMask_10.in)  # same code as code_block_39
translate_6 = Geometry.Translate(geometry=splitByPoints_3, direction=normalAtParameter_6, distance=code_block_131.t7, lacing=Longest)
function_apply_22 = ApplyFunction(func=lastItem, arg1=translate_6)
code_block_132 = CodeBlock(x=code_block_103) { x[3]; }
element_types_ᶜᵒⁿᵛᵉʳᵗᵉᵈ_ᵈʳᵒᵖᵈᵒʷⁿ_5 = CodeBlock { DSCore.Types.FindTypeByNameInAssembly("RebarHookType", "RevitAPI"); }
all_elements_of_type_5 = ElementsOfType(element_type=element_types_ᶜᵒⁿᵛᵉʳᵗᵉᵈ_ᵈʳᵒᵖᵈᵒʷⁿ_5)
rebar_hook_type_at_start_2 = CodeBlock(t3=all_elements_of_type_5)  # same code as rebar_hook_type_at_start
direction_6 = Line.Direction(line=code_block_124.out1)
Z_6 = Vector.Z(vector=direction_6)
code_block_133 = CodeBlock { 0; }
lt_6 = Z_6 < code_block_133
code_block_134 = CodeBlock { "Left"; "Right"; }
if_6 = If(test=lt_6, true=code_block_134.out0, false=code_block_134.out1)
lastItem_2 = List.LastItem()  # unwired: list
function_apply_23 = ApplyFunction(func=lastItem_2, arg1=filterByBoolMask_10.in)
reverse_6 = Vector.Reverse(vector=normalAtParameter_6)
code_block_135 = CodeBlock(curves=function_apply_22, rebarBarType=code_block_132, endHookType=rebar_hook_type_at_start_2.t5, startHookOrientation=if_6, endtHookOrientation=if_6, hostElement=function_apply_23, vector=reverse_6)
# ---------- code_block_135.designscript (18 lines) ----------
//curves
curves;
//rebarStyle
"Standard";
//rebarBarType
rebarBarType;
//startHookType
null;
//endHookType
endHookType;
//startHookOrientation
startHookOrientation;
//endtHookOrientation
endtHookOrientation;
//hostElement
hostElement;
//vector
vector;
# ----------------------------------------
fromCurves_3 = StructuralDesign.Rebar.Create.FromCurves(curves=code_block_135.curves@L1, rebarStyle=code_block_135.out1@L1, rebarBarType=code_block_135.rebarBarType@L1, startHookType=code_block_135.out3@L1, endHookType=code_block_135.endHookType@L1, startHookOrientation=code_block_135.startHookOrientation@L1, endHookOrientation=code_block_135.endtHookOrientation@L1, hostElement=code_block_135.hostElement@L1, vector=code_block_135.vector@L1, lacing=Longest)
code_block_136 = CodeBlock(t2=filterByBoolMask_10.in)  # same code as code_block_44
code_block_137 = CodeBlock(x=code_block_103) { x[4]; }
setLayoutAsFixedNumber_3 = StructuralDesign.Rebar.Layout.SetLayoutAsFixedNumber(rebar=fromCurves_3, arrayLength=code_block_136.t4, numberOfBarPositions=code_block_137)
element_types_ᶜᵒⁿᵛᵉʳᵗᵉᵈ_ᵈʳᵒᵖᵈᵒʷⁿ_6 = CodeBlock { DSCore.Types.FindTypeByNameInAssembly("RebarShape", "RevitAPI"); }
all_elements_of_type_6 = ElementsOfType(element_type=element_types_ᶜᵒⁿᵛᵉʳᵗᵉᵈ_ᵈʳᵒᵖᵈᵒʷⁿ_6)
code_block_138 = CodeBlock(t1=all_elements_of_type_6)  # same code as code_block_46
setParameterByName_3 = Element.SetParameterByName(element=setLayoutAsFixedNumber_3, parameterName=code_block_138.out0, value=code_block_138.t4, lacing=Longest)
rebarCenterlineCurves_5 = StructuralDesign.Rebar.Properties.RebarCenterlineCurves(rebar=setParameterByName_3)
code_block_139 = CodeBlock { 0.5; }
pointAtParameter_23 = Curve.PointAtParameter(curve=rebarCenterlineCurves_5, param=code_block_139)
code_block_140 = CodeBlock()  # same code as code_block_48
create_tag_3 = Custom[Create Tag](view=o_document_activeview_7@L1, element=setParameterByName_3@L1, TagLocation=pointAtParameter_23@L1, TagType=code_block_140.familytype1@L1, addLeader=code_block_140.out2@L1, RunIt=code_block_140.out3@L1, lacing=Longest)
flatten_28 = List.Flatten(list=create_tag_3)
code_block_141 = CodeBlock { "Walls"; }
byName_3 = Category.ByName(name=code_block_141)
o_document_activeview_8 = Orchid.RevitProject.Common.Document.ActiveView()
all_elements_of_category_in_view_3 = ElementsOfCategoryInView(Category=byName_3, View=o_document_activeview_8)
geometry_9 = Element.Geometry(element=all_elements_of_category_in_view_3)
flatten_29 = List.Flatten(list=geometry_9)
byUnion_6 = Solid.ByUnion(solids=flatten_29)
annotation_boundingbox_5 = Custom[Annotation BoundingBox](element=flatten_28)
code_block_142 = CodeBlock { null; }
replaceEmptyLists_8 = Custom[List.ReplaceEmptyLists](seq=annotation_boundingbox_5.Centroid, Replacement=code_block_142)
code_block_143 = CodeBlock(x=replaceEmptyLists_8)  # same code as code_block_51
code_block_144 = CodeBlock { 100; 2000; 100; }
byLengths_3 = Cuboid.ByLengths(origin=code_block_143.out1, width=code_block_144.out0, length=code_block_144.out1, height=code_block_144.out2)
doesIntersect_6 = Geometry.DoesIntersect(geometry=byUnion_6, other=byLengths_3, lacing=Longest)
filterByBoolMask_11 = List.FilterByBoolMask(list=flatten_28@L2, mask=doesIntersect_6@L2)
flatten_30 = List.Flatten(list=filterByBoolMask_11.in)
mirror_3 = Geometry.Mirror()  # unwired: geometry, mirrorPlane
annotation_boundingbox_6 = Custom[Annotation BoundingBox](element=flatten_30@L2)
taggedElement_3 = Tag.TaggedElement()  # unwired: tag
function_apply_24 = ApplyFunction(func=taggedElement_3, arg1=flatten_30)
code_block_145 = CodeBlock { null; }
replaceEmptyLists_9 = Custom[List.ReplaceEmptyLists](seq=function_apply_24, Replacement=code_block_145)
code_block_146 = CodeBlock(l=replaceEmptyLists_9)  # same code as code_block_54
rebarCenterlineCurves_6 = StructuralDesign.Rebar.Properties.RebarCenterlineCurves(rebar=code_block_146.out1)
length_3 = Curve.Length(curve=rebarCenterlineCurves_6)
maximumItem_3 = List.MaximumItem(list=length_3)
eq_6 = length_3 == maximumItem_3
filterByBoolMask_12 = List.FilterByBoolMask(list=rebarCenterlineCurves_6, mask=eq_6)
flatten_31 = List.Flatten(list=filterByBoolMask_12.in)
code_block_147 = CodeBlock { 0.5; }
pointAtParameter_24 = Curve.PointAtParameter(curve=flatten_31, param=code_block_147)
o_document_activeview_9 = Orchid.RevitProject.Common.Document.ActiveView()
plane_3 = Custom[View.Plane](view=o_document_activeview_9)
normal_3 = Plane.Normal(plane=plane_3)
byOriginNormal_6 = Plane.ByOriginNormal(origin=pointAtParameter_24, normal=normal_3)
byLine_3 = StructuralDesign.Model.Geom.Vector.ByLine(line=flatten_31)
code_block_148 = CodeBlock { 90; }
rotate_6 = Geometry.Rotate(geometry=byOriginNormal_6, origin=pointAtParameter_24, axis=byLine_3, degrees=code_block_148)
function_apply_25 = ApplyFunction(func=mirror_3, arg1=annotation_boundingbox_6.Centroid, arg2=rotate_6)
tag_setlocation_3 = Custom[Tag SetLocation](tag=flatten_30@L2, location=function_apply_25@L2)
